# Grasshopper definition geostreamer2.gh (Grasshopper 1.0.7)
# plug-ins: GeoGrasshopper

number_slider = Slider(25, range=1..100)
idxtest = IndexTestComponent(Number=Slider(78, range=0..100), Number_2=0)
panel = Panel(idxtest)
brep = Brep(<brep referenced from the Rhino model>)

series = Series(Start=0, Step=expr("1/x", number_slider), Count=expr("x+1", number_slider))
crv = Curve(<curve referenced from the Rhino model>)
crv_2 = Curve(<curve referenced from the Rhino model>)
tweencrv = TweenCurve(CurveA=crv, CurveB=crv_2, Factor=series, BlendType=0)
mesh = MeshBrep(
    Brep=brep,
    Settings={GridMaxCount=0, GridMinCount=16, JaggedSeams=False, MaxEdgeLength=0, MinEdgeLength=0.0001, MinTolerance=0, Refine=True, RefineAngle=0, RelativeTolerance=0.65, SimplePlanes=True, Tolerance=0})  # -> flatten(Mesh)

curve = ColourSwatch(SwatchColor=RGB(101, 155, 199))
material = CreateMaterial(Diffuse=curve, Specular=curve, Emission=RGB(0, 0, 0), Transparency=Slider(0.2, range=0..1), Shine=0)
gs_settings = StreamSettings(Material=material, CurveDivision=Slider(4, range=0..100), CurveWidth=Slider(0.09, range=0..0.1))
connect = BooleanToggle(False)
update = Button()
streampreview = StreamPreviewComponent(Geometry=mesh, Settings=gs_settings)
geostream = GeometryStreamer(IpAdress="192.168.43.45", Connect=connect, UpdateDebug=update, Geometry=mesh, Settings=gs_settings)
